# Grasshopper definition POST_PROCESSING_FINAL_VERSION.gh (Grasshopper 1.0.8)
# plug-ins: MeshEdit Components, Pufferfish, GSA, Kangaroo2 Components, Telepathy

# ---- group: trial
panel = Panel("C:\My_Files\Uni_Stuff\2024-2025 YR5\Semester 1\Grasshopper files\18\check for smaller chains_bup_bup_bup.gwb")
open_model = OpenModel(FilenameAndPath=panel)

# ----
panel_2 = Panel("C:\My_Files\Uni_Stuff\2024-2025 YR5\Semester 1\Grasshopper files\Final version\GSA\changing warp weft orientation\warp sagging weft hogging.gwb")
# OPENING
# GSA MODEL
panel_3 = Panel("C:\My_Files\Uni_Stuff\2024-2025 YR5\Semester 1\Grasshopper files\Final version\GSA\changing warp weft orientation\warp hogging weft sagging.gwb")
panel_4 = Panel("C:\My_Files\Uni_Stuff\2024-2025 YR5\Semester 1\Grasshopper files\Final version\GSA\varying span\6ARCHES.gwb")
panel_5 = Panel("C:\My_Files\Uni_Stuff\2024-2025 YR5\Semester 1\Grasshopper files\Final version\GSA\varying span\CONTROL_8 ARCHES_ANALYSED.gwb")
panel_6 = Panel("C:\My_Files\Uni_Stuff\2024-2025 YR5\Semester 1\Grasshopper files\Final version\GSA\varying span\10ARCHES.gwb")
panel_7 = Panel("C:\My_Files\Uni_Stuff\2024-2025 YR5\Semester 1\Grasshopper files\Final version\GSA\varying prestress\8.5PRESTRESS.gwb")
panel_8 = Panel("C:\My_Files\Uni_Stuff\2024-2025 YR5\Semester 1\Grasshopper files\Final version\GSA\varying prestress\17PRESTRESS_CONTROL.gwb")
panel_9 = Panel("C:\My_Files\Uni_Stuff\2024-2025 YR5\Semester 1\Grasshopper files\Final version\GSA\varying prestress\34PRESTRESS.gwb")
panel_10 = Panel("C:\My_Files\Uni_Stuff\2024-2025 YR5\Semester 1\Grasshopper files\Final version\GSA\CHANGING MATERIAL\weaker PTFE.gwb")
panel_11 = Panel("C:\My_Files\Uni_Stuff\2024-2025 YR5\Semester 1\Grasshopper files\Final version\GSA\CHANGING MATERIAL\control PTFE.gwb")
panel_12 = Panel("C:\My_Files\Uni_Stuff\2024-2025 YR5\Semester 1\Grasshopper files\Final version\GSA\CHANGING MATERIAL\stronger PTFE.gwb")
panel_13 = Panel("C:\My_Files\Uni_Stuff\2024-2025 YR5\Semester 1\Grasshopper files\Final version\GSA\varying height\0.6HEIGHT.gwb")
panel_14 = Panel("C:\My_Files\Uni_Stuff\2024-2025 YR5\Semester 1\Grasshopper files\Final version\GSA\varying height\0.8HEIGHT.gwb")
panel_15 = Panel("C:\My_Files\Uni_Stuff\2024-2025 YR5\Semester 1\Grasshopper files\Final version\GSA\varying height\FULLHEIGHT.gwb")

# ---- group: changing fabric orientation
open_model_2 = OpenModel(FilenameAndPath=panel_3)
open_model_3 = OpenModel(FilenameAndPath=panel_2)

# ---- group: changing spans
open_model_4 = OpenModel(FilenameAndPath=panel_4)
open_model_5 = OpenModel(FilenameAndPath=panel_5)
open_model_6 = OpenModel(FilenameAndPath=panel_6)

# ---- group: changing prestress
open_model_7 = OpenModel(FilenameAndPath=panel_7)
open_model_8 = OpenModel(FilenameAndPath=panel_8)
open_model_9 = OpenModel(FilenameAndPath=panel_9)

# ---- group: changing material
open_model_10 = OpenModel(FilenameAndPath=panel_10)
open_model_11 = OpenModel(FilenameAndPath=panel_11)
open_model_12 = OpenModel(FilenameAndPath=panel_12)

# ---- group: changing height
open_model_13 = OpenModel(FilenameAndPath=panel_13)
open_model_14 = OpenModel(FilenameAndPath=panel_14)
open_model_15 = OpenModel(FilenameAndPath=panel_15)

# ---- group: FOR PATTERNING
get_model_geometry = GetModelGeometry(GSAModel=open_model_6, Mode=1, Unit="m")  # -> NodesIn_mm, _1DElementsIn_mm, _2DElementsIn_mm, _3DElementsIn_mm, _1DMembersIn_mm, _2DMembersIn_mm, _3DMembersIn_mm, Assemblies
mesh = Mesh(get_model_geometry._2DElementsIn_mm)
analysedmesh = RemoteSender(mesh)

# ---- group: spliting mesh// old version// not reliable
# LIST OF PLUGINS REQUIRED:
# - KANGAROO 2
# - GH GSA PLUGIN
# - TELEPATHY
# - PUFFERFISH
splitting_angle_degrees = Slider(13, range=0..90)  # disabled
analysedmesh_2 = RemoteReceiver(analysedmesh)  # disabled
# PATTERNING STEP 1
# 
# FLATTENING
angle_split_mesh = AngleSplitMesh(Mesh=analysedmesh_2, Angle=splitting_angle_degrees, Opposite=False)  # -> Split, ResultBoolean; disabled

# ---- group: spliting mesh// old version// not reliable / TO CHECK IF MESH SPLIT PROPERLY
mesh_part_i = Slider(9, range=0..10)  # disabled
list_item = ListItem(List=angle_split_mesh.Split, Index=mesh_part_i, Wrap=True)  # -> Item, Item1, Item2, Item3; disabled
mesh_2 = Mesh(list_item.Item)  # disabled

# ----
analysedmesh_3 = RemoteReceiver(analysedmesh)
deconstruct_mesh = DeconstructMesh(Mesh=analysedmesh_3)  # -> Vertices, Faces, Colours, Normals
mesh_explode = MeshExplode(Mesh=analysedmesh_3, Interpolate=False)
number_of_quads_in_v_direction = Panel("21")
number_of_quad_in_u_direction = Panel("21")
deconstruct_face = DeconstructFace(Face=deconstruct_mesh.Faces)  # -> CornerA, CornerB, CornerC, CornerD
list_length = ListLength(List=mesh_explode)
multiplication = Multiplication(A=number_of_quad_in_u_direction, B=number_of_quads_in_v_direction)
list_item_2 = ListItem(List=deconstruct_mesh.Vertices, Index=deconstruct_face.CornerA, Wrap=True)
division = Division(A=list_length, B=multiplication)
deconstruct = Deconstruct(Point=list_item_2)  # -> XComponent, YComponent, ZComponent
division_2 = Division(A=list_length, B=division)
sort_list = SortList(Keys=deconstruct.XComponent, ValuesA=mesh_explode)  # -> Keys, ValuesA
partition_list = PartitionList(List=sort_list.ValuesA, Size=division_2)  # -> simplify(Chunks)
mesh_join = MeshJoin(Meshes=partition_list)
tree_branch = TreeBranch(Tree=mesh_join, Path=Slider(9, range=0..9), MaintainPaths=True)
meshturn = MeshTurn(Mesh=mesh_join)
origin = Point(Point(0, 0, 0))
move_away_from = MoveAwayFrom(Geometry=mesh_join, Emitter=origin, Distance=10)  # -> Geometry, Transform
refinestrips = RefineStrips(Mesh=meshturn, Level=Slider(3, range=1..5))
refinestrips_2 = RefineStrips(Mesh=mesh_join, Level=1)
refine = Refine(Mesh=mesh_join, Level=1)
meshturn_2 = MeshTurn(Mesh=refinestrips)
stripper = Stripper(Mesh=meshturn_2)  # -> simplify(Strips)
strips = RemoteSender(stripper)
origin_2 = Point(Point(0, 0, 0))
of_unrolling_completed = Slider(1, range=0..1)
move_away_from_2 = MoveAwayFrom(Geometry=stripper, Emitter=origin_2, Distance=10)  # -> Geometry, Transform
unroller = Unroller(Strip=stripper, Unroll=of_unrolling_completed)  # -> graft(Unrolled)
unrolled_mesh_strips = RemoteSender(unroller)

# ---- group: DESCRIPTION OF ANALYSIS CASES
get_model_analysis = GetModelAnalysis(GSAModel=open_model_5)  # -> AnalysisTasks, AnalysisCases, CombinationCases, DesignTasks
series = Series(Start=0, Step=1, Count="4")
list_item_3 = ListItem(List=get_model_analysis.AnalysisCases, Index=series, Wrap=True)
all_analysis_cases = Panel(list_item_3)

# ----
# ANALYSIS
select_result = SelectResult(GSAModel=open_model_5, Type="AnalysisCase", Case_ID="A4")

# ---- group: GLOBAL DISPLACEMENTS
element_2d_displacements = Element2DDisplacements(Result=select_result, ElementMemberFilterList="PA", Axis="0", Max_Min="All", Unit="mm")  # -> TranslationsX_mm, TranslationsY_mm, TranslationsZ_mm, TranslationsXYZ_mm, RotationXX_rad, RotationYY_rad, RotationZZ_rad, RotationXYZ_rad
replace_text = ReplaceText(Text=element_2d_displacements.TranslationsX_mm, Find="mm", RecursiveReplace=False)
number = Number(replace_text)
panel_16 = Panel(number)

# ---- group: FOR FIGURE
# FOR MAKING FIGURES:
# IGNORE
mesh_explode_2 = MeshExplode(Mesh=angle_split_mesh.Split, Interpolate=False)
list_item_4 = ListItem(List=mesh_explode_2, Index=Slider(399, range=399..420), Wrap=True)
face_normals = FaceNormals(Mesh=list_item_4)  # -> Centers, Normals
plane_normal = PlaneNormal(Origin=face_normals.Centers, ZAxis=face_normals.Normals)

# ---- group: TARGET PLANES
# PATTERNING STEP 2
# ORIENTATING TO XY PLANE
unrolled_mesh_strips_2 = RemoteReceiver(unrolled_mesh_strips)
trim_tree = TrimTree(Tree=unrolled_mesh_strips_2, Depth=1)
tree_statistics = TreeStatistics(Tree=trim_tree)  # -> Paths, Length, Count
subtraction = Subtraction(A=tree_statistics.Length, B="1")
subtraction_2 = Subtraction(A=tree_statistics.Count, B="1")
construct_domain = ConstructDomain(DomainStart=0, DomainEnd=subtraction)
construct_domain_2 = ConstructDomain(DomainStart=0, DomainEnd=subtraction_2)
range = Range(Domain=construct_domain_2, Steps=subtraction_2)  # -> graft(Range)
range_2 = Range(Domain=construct_domain, Steps=subtraction)
multiplication_2 = Multiplication(A=Slider(36, range=0..100), B=range_2)
multiplication_3 = Multiplication(A=Slider(71, range=1..100), B=range)
vector_xyz = VectorXYZ(XComponent=multiplication_2, YComponent=multiplication_3, ZComponent=0)  # -> flatten(Vector), Length
xy_plane = XYPlane(Origin=Point(0, 0, 0))
rotate = Rotate(Geometry=xy_plane, Angle=1.570796327, Plane=PlaneXY(0, 0, 0))  # -> Geometry, Transform
negative = Negative(Value=vector_xyz.Vector)
move = Move(Geometry=rotate.Geometry, Motion=negative)  # -> Geometry, Transform
motion_vector = RemoteSender(negative)
target_planes = RemoteSender(move.Geometry)

# ---- group: SOURCE PLANE
unrolled_mesh_strips_3 = RemoteReceiver(unrolled_mesh_strips)
mesh_explode_3 = MeshExplode(Mesh=unrolled_mesh_strips_3, Interpolate=False)
list_item_5 = ListItem(List=mesh_explode_3, Index=0, Wrap=True)
list_item_6 = ListItem(List=mesh_explode_3, Index=-1, Wrap=True)
face_normals_2 = FaceNormals(Mesh=list_item_6)  # -> Centers, Normals
face_normals_3 = FaceNormals(Mesh=list_item_5)  # -> Centers, Normals
vector_2pt = Vector2Pt(PointA=face_normals_3.Centers, PointB=face_normals_2.Centers, Unitize=False)  # -> Vector, Length
plane_normal_2 = PlaneNormal(Origin=face_normals_3.Centers, ZAxis=face_normals_3.Normals)
unrolled_mesh_strips_4 = RemoteReceiver(unrolled_mesh_strips)
align_plane = AlignPlane(Plane=plane_normal_2, Direction=vector_2pt.Vector)  # -> flatten(Plane), Angle
bounding_box = BoundingBox(Content=unrolled_mesh_strips_4, Plane=graft(align_plane.Plane))  # -> flatten(Box), Box_2
box_corners = BoxCorners(Box=bounding_box.Box)  # -> CornerA, CornerB, CornerC, CornerD, CornerE, CornerF, CornerG, CornerH
plane_origin = PlaneOrigin(Base=align_plane.Plane, Origin=box_corners.CornerD)
source_plane = RemoteSender(plane_origin)

# ---- group: for figure // SHOWING A SET OF XY PLANES FOR THE PANELS TO SIT ON
unrolled_mesh_strips_5 = RemoteReceiver(unrolled_mesh_strips)
target_planes_2 = RemoteReceiver(target_planes)
trim_tree_2 = TrimTree(Tree=unrolled_mesh_strips_5, Depth=1)
plane = Plane(target_planes_2)
# click on input and click "f" to flatten
unflatten_tree = UnflattenTree(Tree=plane, Guide=trim_tree_2)
shift_list = ShiftList(List=unflatten_tree, Shift=Slider(15, range=0..20), Wrap=True)
shift_list_2 = ShiftList(List=unflatten_tree, Shift=Slider(10, range=0..20), Wrap=True)
shift_list_3 = ShiftList(List=unflatten_tree, Shift=Slider(5, range=0..20), Wrap=True)
list_item_7 = ListItem(List=shift_list_3, Index=0, Wrap=True)
list_item_8 = ListItem(List=shift_list_2, Index=0, Wrap=True)
list_item_9 = ListItem(List=unflatten_tree, Index=0, Wrap=True)  # -> Item1, Item
list_item_10 = ListItem(List=shift_list, Index=0, Wrap=True)
plane_2 = Plane([list_item_9.Item1, list_item_9.Item, list_item_10, list_item_8, list_item_7])

# ---- group: PATTERNS
unrolled_mesh_strips_6 = RemoteReceiver(unrolled_mesh_strips)
target_planes_3 = RemoteReceiver(target_planes)
source_plane_2 = RemoteReceiver(source_plane)
orient = Orient(Geometry=flatten(unrolled_mesh_strips_6), Source=source_plane_2, Target=target_planes_3)  # -> simplify(Geometry), Transform
flat_mesh_strips = RemoteSender(orient.Geometry)

# ---- group: diagram // ROTATING FLATTENED PANEL TO XY
unrolled_mesh_strips_7 = RemoteReceiver(unrolled_mesh_strips)
flat_mesh_strips_2 = RemoteReceiver(flat_mesh_strips)
target_planes_4 = RemoteReceiver(target_planes)
source_plane_3 = RemoteReceiver(source_plane)
mesh_3 = Mesh(flatten(unrolled_mesh_strips_7))
area = Area(Geometry=flat_mesh_strips_2)  # -> Area, Centroid
area_2 = Area(Geometry=mesh_3)  # -> Area, Centroid
vector_2pt_2 = Vector2Pt(PointA=area_2.Centroid, PointB=area.Centroid, Unitize=False)  # -> Vector, Length
line = Line(StartPoint=area_2.Centroid, EndPoint=area.Centroid)
entwine = Entwine(
    Branch00=source_plane_3,
    Branch01=mesh_3,
    Branch02=flat_mesh_strips_2,
    Branch03=target_planes_4,
    Branch04=line,
    Branch05=area_2.Centroid,
    Branch06=area.Centroid,
    FlattenInputs=True)
list_item_11 = ListItem(List=entwine, Index=Slider(3, range=0..83), Wrap=True)  # -> flatten(Item)
list_item_12 = ListItem(List=list_item_11, Index="4", Wrap=True)
list_item_13 = ListItem(List=list_item_11, Index="5", Wrap=True)
list_item_14 = ListItem(List=list_item_11, Index="6", Wrap=True)
number_slider = Slider(0, range=0..192)
width_units = WidthUnits(2)
unit_x = UnitX(Factor="-0.5")
move_2 = Move(Geometry=[list_item_13, list_item_14], Motion=unit_x)  # -> Geometry, Transform
colour_rgb = ColourRGB(Alpha=255, Red=number_slider, Green=number_slider, Blue=number_slider)
create_material = CreateMaterial(Diffuse=RGB(255, 105, 180), Specular=RGB(255, 255, 255), Emission=colour_rgb, Transparency=0, Shine=0)
list_item_15 = ListItem(List=list_item_11, Index="1", Wrap=True)  # -> Item1, Item
list_item_16 = ListItem(List=list_item_11, Index="2", Wrap=True)  # -> Item, Item1
custom_preview = CustomPreview(Geometry=[list_item_13, list_item_14], Material=create_material)
vector_display = VectorDisplay(Anchor=list_item_13, Vector=list_item_12)
point_list = PointList(Points=move_2.Geometry, Size=Slider(0.32, range=0..10))

# ---- group: PATTERN BUT AS ONE SURFACE INSTEAD OF MESH
# PATTERNING OUTPUTS
flat_mesh_strips_3 = RemoteReceiver(flat_mesh_strips)
mesh_edges = MeshEdges(Mesh=flat_mesh_strips_3)  # -> NakedEdges, InteriorEdges, NonManifoldEdges
join_curves = JoinCurves(Curves=mesh_edges.NakedEdges, Preserve=False)
boundary_surfaces = BoundarySurfaces(Edges=join_curves)  # -> simplify(flatten(Surfaces))

# ---- group: scaling step
# scale in x and y direction separately
warp_scale = Slider(0.9955, range=0..1)
weft_scale = Slider(0.9945, range=0..1)
target_planes_5 = RemoteReceiver(target_planes)
scale_nu = ScaleNU(Geometry=boundary_surfaces, Plane=target_planes_5, ScaleX=warp_scale, ScaleY=weft_scale, ScaleZ=1)  # -> Geometry, Transform
scaled_panels = Surface(scale_nu.Geometry)

# ---- group: FIGURE // CORRECTING THE PLANE OF FIRST QUAD
mesh_4 = Mesh(flatten(list_item_5))
vector = Vector(flatten(vector_2pt.Vector))
mesh_5 = Mesh(flatten(list_item_6))
point = Point(flatten(face_normals_3.Centers))
plane_3 = Plane(flatten(plane_normal_2))
point_2 = Point(flatten(face_normals_2.Centers))
plane_4 = Plane(align_plane.Plane)
cull_pattern = CullPattern(List=point_2, CullPattern=[True, False, False])
cull_pattern_2 = CullPattern(List=plane_4, CullPattern=[True, False, False])
cull_pattern_3 = CullPattern(List=plane_3, CullPattern=[True, False, False])
cull_pattern_4 = CullPattern(List=point, CullPattern=[True, False, False])
cull_pattern_5 = CullPattern(List=mesh_5, CullPattern=[True, False, False])
cull_pattern_6 = CullPattern(List=vector, CullPattern=[True, False, False])
cull_pattern_7 = CullPattern(List=mesh_4, CullPattern=[True, False, False])
list_item_17 = ListItem(List=cull_pattern, Index=0, Wrap=True)  # -> Item, Item1, Item2
list_item_18 = ListItem(List=cull_pattern_6, Index=0, Wrap=True)  # -> Item, Item1, Item2
list_item_19 = ListItem(List=cull_pattern_4, Index=0, Wrap=True)  # -> Item, Item1, Item2
list_item_20 = ListItem(List=cull_pattern_2, Index=0, Wrap=True)  # -> Item, Item1, Item2
list_item_21 = ListItem(List=cull_pattern_3, Index=0, Wrap=True)  # -> Item, Item1, Item2
number_slider_2 = Slider(0.8, range=0..1)
list_item_22 = ListItem(List=cull_pattern_5, Index=0, Wrap=True)  # -> Item, Item1, Item2
list_item_23 = ListItem(List=cull_pattern_7, Index=0, Wrap=True)  # -> Item, Item1, Item2
plane_5 = Plane([list_item_20.Item1, list_item_21.Item1])
create_material_2 = CreateMaterial(
    Diffuse=ColourSwatch(SwatchColor=RGB(36, 82, 199)),
    Specular=RGB(255, 255, 255),
    Emission=RGB(0, 0, 0),
    Transparency=number_slider_2,
    Shine=0)
create_material_3 = CreateMaterial(
    Diffuse=ColourSwatch(SwatchColor=RGB(199, 36, 36)),
    Specular=RGB(255, 255, 255),
    Emission=RGB(0, 0, 0),
    Transparency=number_slider_2,
    Shine=0)
mesh_6 = Mesh([list_item_23.Item1, list_item_22.Item1])
create_material_4 = CreateMaterial(
    Diffuse=ColourSwatch(SwatchColor=RGB(0, 0, 0)),
    Specular=RGB(255, 255, 255),
    Emission=RGB(0, 0, 0),
    Transparency=0,
    Shine=0)
custom_preview_2 = CustomPreview(Geometry=list_item_20.Item1, Material=create_material_3)
custom_preview_3 = CustomPreview(Geometry=list_item_21.Item1, Material=create_material_2)
vector_display_2 = VectorDisplay(Anchor=list_item_19.Item1, Vector=list_item_18.Item1)
custom_preview_4 = CustomPreview(Geometry=mesh_6, Material=create_material_4)
point_3 = Point([list_item_19.Item1, list_item_17.Item1])

# ---- group: For animation CONTROL PANEL
orient_2 = Orient(Geometry=flatten(plane_origin), Source=plane_origin, Target=move.Geometry)  # -> Geometry, Transform
multiplication_4 = Multiplication(A=Slider(5, range=0..10), B=Slider(0.2, range=0..0.2))
transform = Transform(orient_2.Transform)
inverse_transform = InverseTransform(Transform=transform)
slide_within_transform = SlideWithinTransform(Transform=inverse_transform, Factor=multiplication_4)
target_planes_6 = RemoteReceiver(target_planes)
transform_2 = Transform(Geometry=target_planes_6, Transform=slide_within_transform)
unrolled_mesh_strips_8 = RemoteReceiver(unrolled_mesh_strips)
target_planes_7 = RemoteReceiver(target_planes)
orient_3 = Orient(Geometry=flatten(unrolled_mesh_strips_8), Source=transform_2, Target=target_planes_7)  # -> simplify(Geometry), Transform

# ---- group: FOR ANIMATION
unrolled_mesh_strips_9 = RemoteReceiver(unrolled_mesh_strips)
mesh_edges_2 = MeshEdges(Mesh=unrolled_mesh_strips_9)  # -> NakedEdges, InteriorEdges, NonManifoldEdges
join_curves_2 = JoinCurves(Curves=mesh_edges_2.NakedEdges, Preserve=False)  # -> flatten(Curves)
boundary_surfaces_2 = BoundarySurfaces(Edges=join_curves_2)

# ---- group: FOR ANIMATION / geometry to observe for animation
target_planes_8 = RemoteReceiver(target_planes)
source_plane_4 = RemoteReceiver(source_plane)
orient_4 = Orient(Geometry=flatten(boundary_surfaces_2), Source=source_plane_4, Target=target_planes_8)  # -> simplify(Geometry), Transform

# ---- group: GETTING THE WIDTHS AND HEIGHTS FOR EACH PANEL
flat_mesh_strips_4 = RemoteReceiver(flat_mesh_strips)
deconstruct_mesh_2 = DeconstructMesh(Mesh=flat_mesh_strips_4)  # -> Vertices, Faces, Colours, Normals
deconstruct_2 = Deconstruct(Point=deconstruct_mesh_2.Vertices)  # -> XComponent, YComponent, ZComponent
sort_list_2 = SortList(Keys=deconstruct_2.XComponent, ValuesValuesA=deconstruct_mesh_2.Vertices)  # -> Keys, ValuesValuesA
list_item_24 = ListItem(List=reverse(sort_list_2.ValuesValuesA), Index=0, Wrap=True)
list_item_25 = ListItem(List=sort_list_2.ValuesValuesA, Index=0, Wrap=True)
vector_2pt_3 = Vector2Pt(PointA=list_item_25, PointB=list_item_24, Unitize=False)  # -> Vector, Length
deconstruct_vector = DeconstructVector(Vector=vector_2pt_3.Vector)  # -> flatten(XComponent), YComponent, ZComponent
panel_17 = Panel(deconstruct_vector.XComponent)

flat_mesh_strips_5 = RemoteReceiver(flat_mesh_strips)
deconstruct_mesh_3 = DeconstructMesh(Mesh=flat_mesh_strips_5)  # -> Vertices, Faces, Colours, Normals
deconstruct_3 = Deconstruct(Point=deconstruct_mesh_3.Vertices)  # -> XComponent, YComponent, ZComponent
sort_list_3 = SortList(Keys=deconstruct_3.YComponent, ValuesValuesA=deconstruct_mesh_3.Vertices)  # -> Keys, ValuesValuesA
list_item_26 = ListItem(List=reverse(sort_list_3.ValuesValuesA), Index=0, Wrap=True)
list_item_27 = ListItem(List=sort_list_3.ValuesValuesA, Index=0, Wrap=True)
vector_2pt_4 = Vector2Pt(PointA=list_item_27, PointB=list_item_26, Unitize=False)  # -> Vector, Length
deconstruct_vector_2 = DeconstructVector(Vector=vector_2pt_4.Vector)  # -> XComponent, flatten(YComponent), ZComponent
panel_18 = Panel(deconstruct_vector_2.YComponent)

# ---- group: LINES TO link panels with neighbours
flat_mesh_strips_6 = RemoteReceiver(flat_mesh_strips)
face_normals_4 = FaceNormals(Mesh=flat_mesh_strips_6)  # -> Centers, Normals
tree_statistics_2 = TreeStatistics(Tree=face_normals_4.Centers)  # -> Paths, Length, Count
division_3 = Division(A=tree_statistics_2.Length, B="2")
list_item_28 = ListItem(List=face_normals_4.Centers, Index=division_3, Wrap=True)
strips_2 = RemoteReceiver(strips)
point_4 = Point(list_item_28)
list_item_29 = ListItem(List=point_4, Index=0, Wrap=True)
unflatten_tree_2 = UnflattenTree(Tree=list_item_29, Guide=strips_2)
flip_matrix = FlipMatrix(Data=unflatten_tree_2)
shift_list_4 = ShiftList(List=unflatten_tree_2, Shift="-1", Wrap=False)
shift_list_5 = ShiftList(List=flip_matrix, Shift="-1", Wrap=False)
shift_list_6 = ShiftList(List=unflatten_tree_2, Shift=1, Wrap=False)
shift_list_7 = ShiftList(List=flip_matrix, Shift=1, Wrap=False)
line_2 = Line(StartPoint=shift_list_5, EndPoint=shift_list_7)  # -> flatten(Line)
number_slider_3 = Slider(-0.56, range=-1..0)
number_slider_4 = Slider(-0.63, range=-1..0)
line_3 = Line(StartPoint=shift_list_4, EndPoint=shift_list_6)  # -> flatten(Line)
extend_curve = ExtendCurve(Curve=line_3, Type=0, Start=number_slider_3, End=number_slider_3)
extend_curve_2 = ExtendCurve(Curve=line_2, Type=0, Start=number_slider_4, End=number_slider_4)
curve = Curve([extend_curve, extend_curve_2])
lines_linking_panels_to_its_neighbours = RemoteSender(curve)

# ---- group: GETTING THE WIDTHS AND HEIGHTS FOR EACH PANEL / check for vector method
deconstruct_4 = Deconstruct(Point=list_item_27)  # -> XComponent, YComponent, ZComponent
deconstruct_5 = Deconstruct(Point=list_item_26)  # -> XComponent, YComponent, ZComponent
subtraction_3 = Subtraction(A=deconstruct_5.YComponent, B=deconstruct_4.YComponent)
panel_19 = Panel(subtraction_3)
equality = Equality(FirstNumber=panel_18, SecondNumber=flatten(panel_19))  # -> Equality, Inequality
panel_20 = Panel(equality.Equality)

# ---- group: DIMENSIONS / width dimensions
deconstruct_6 = Deconstruct(Point=flatten(list_item_25))  # -> XComponent, YComponent, ZComponent
deconstruct_7 = Deconstruct(Point=flatten(list_item_24))  # -> XComponent, YComponent, ZComponent
construct_point = ConstructPoint(XCoordinate=deconstruct_6.XComponent, YCoordinate=0, ZCoordinate=0)
construct_point_2 = ConstructPoint(XCoordinate=deconstruct_7.XComponent, YCoordinate=0, ZCoordinate=0)
line_4 = Line(StartPoint=construct_point, EndPoint=construct_point_2)  # -> flatten(Line)
motion_vector_2 = RemoteReceiver(motion_vector)
move_3 = Move(Geometry=line_4, Motion=motion_vector_2)  # -> Geometry, Transform
point_5 = Point(flatten(list_item_25))
point_6 = Point(flatten(list_item_24))
linear_dimension = LinearDimension(Line=move_3.Geometry, PointA=point_5, PointB=point_6, Text="{0:0.00}", Size=0.3)

# ---- group: DIMENSIONS / height dimensions
construct_point_3 = ConstructPoint(XCoordinate=0, YCoordinate=deconstruct_4.YComponent, ZCoordinate=0)
construct_point_4 = ConstructPoint(XCoordinate=0, YCoordinate=deconstruct_5.YComponent, ZCoordinate=0)
line_5 = Line(StartPoint=construct_point_4, EndPoint=construct_point_3)  # -> flatten(Line)
motion_vector_3 = RemoteReceiver(motion_vector)
length = Length(Curve=line_5)
move_4 = Move(Geometry=line_5, Motion=motion_vector_3)  # -> Geometry, Transform
point_7 = Point(flatten(list_item_27))
point_8 = Point(flatten(list_item_26))
panel_21 = Panel(length)
linear_dimension_2 = LinearDimension(Line=move_4.Geometry, PointA=point_7, PointB=point_8, Text="{0:0.00}", Size=0.5)

# ---- group: FIGURE// SHOWING OFF DIMENSIONS FOR PANELS
unrolled_mesh_strips_10 = RemoteReceiver(unrolled_mesh_strips)
unrolled_mesh_strips_11 = RemoteReceiver(unrolled_mesh_strips)
flat_mesh_strips_7 = RemoteReceiver(flat_mesh_strips)
unflatten_tree_3 = UnflattenTree(Tree=point_8, Guide=unrolled_mesh_strips_10)
unflatten_tree_4 = UnflattenTree(Tree=point_7, Guide=unrolled_mesh_strips_10)
unflatten_tree_5 = UnflattenTree(Tree=point_5, Guide=unrolled_mesh_strips_11)
unflatten_tree_6 = UnflattenTree(Tree=point_6, Guide=unrolled_mesh_strips_11)
unrolled_mesh_strips_12 = RemoteReceiver(unrolled_mesh_strips)
trim_tree_3 = TrimTree(Tree=unflatten_tree_3, Depth=1)
trim_tree_4 = TrimTree(Tree=unflatten_tree_4, Depth=1)
trim_tree_5 = TrimTree(Tree=unflatten_tree_6, Depth=1)
trim_tree_6 = TrimTree(Tree=unflatten_tree_5, Depth=1)
unflatten_tree_7 = UnflattenTree(Tree=move_4.Geometry, Guide=unrolled_mesh_strips_10)
explode_tree = ExplodeTree(Data=trim_tree_4)  # -> Branch0, Branch1
unflatten_tree_8 = UnflattenTree(Tree=move_3.Geometry, Guide=unrolled_mesh_strips_11)
explode_tree_2 = ExplodeTree(Data=trim_tree_3)  # -> Branch0, Branch1
unflatten_tree_9 = UnflattenTree(Tree=flat_mesh_strips_7, Guide=unrolled_mesh_strips_12)
explode_tree_3 = ExplodeTree(Data=trim_tree_6)  # -> Branch0, Branch1
explode_tree_4 = ExplodeTree(Data=trim_tree_5)  # -> Branch0, Branch1
trim_tree_7 = TrimTree(Tree=unflatten_tree_7, Depth=1)
list_item_30 = ListItem(List=[explode_tree.Branch1, explode_tree.Branch0], Index=0, Wrap=True)  # -> Item, Item1, Item2
trim_tree_8 = TrimTree(Tree=unflatten_tree_8, Depth=1)
list_item_31 = ListItem(List=[explode_tree_2.Branch1, explode_tree_2.Branch0], Index=0, Wrap=True)  # -> Item, Item1, Item2
list_item_32 = ListItem(List=[explode_tree_3.Branch1, explode_tree_3.Branch0], Index=0, Wrap=True)  # -> Item, Item1, Item2
trim_tree_9 = TrimTree(Tree=unflatten_tree_9, Depth=1)
explode_tree_5 = ExplodeTree(Data=trim_tree_7)  # -> Branch0, Branch1
list_item_33 = ListItem(List=[explode_tree_4.Branch1, explode_tree_4.Branch0], Index=0, Wrap=True)  # -> Item, Item1, Item2
explode_tree_6 = ExplodeTree(Data=trim_tree_8)  # -> Branch0, Branch1
explode_tree_7 = ExplodeTree(Data=trim_tree_9)  # -> Branch0, Branch1
list_item_34 = ListItem(List=[explode_tree_5.Branch1, explode_tree_5.Branch0], Index=0, Wrap=True)  # -> Item, Item1, Item2
list_item_35 = ListItem(List=[explode_tree_6.Branch1, explode_tree_6.Branch0], Index=0, Wrap=True)  # -> Item, Item1, Item2
list_item_36 = ListItem(List=[explode_tree_7.Branch1, explode_tree_7.Branch0], Index=0, Wrap=True)  # -> Item, Item1, Item2
line_6 = Line(flatten([list_item_34.Item, list_item_34.Item1, list_item_34.Item2]))
line_7 = Line(flatten([list_item_35.Item, list_item_35.Item1, list_item_35.Item2]))

# ---- group: GETTING THE WIDTHS AND HEIGHTS FOR EACH PANEL
# assuming that rolls only come in widths in increments of 1m,
sort_list_4 = SortList(Keys=deconstruct_vector.XComponent, ValuesValuesA=deconstruct_vector.XComponent)  # -> Keys, ValuesValuesA
average = Average(Input=sort_list_4.ValuesValuesA)
list_item_37 = ListItem(List=sort_list_4.ValuesValuesA, Index="-1", Wrap=True)
round = Round(Number=list_item_37)  # -> Nearest, Floor, Ceiling
optimum_width_for_roll = Panel(round.Ceiling)

# ---- group: FIGURE// SHOWING OFF DIMENSIONS FOR PANELS / geometry to select for diagram
point_9 = Point(flatten([list_item_31.Item, list_item_31.Item1, list_item_31.Item2]))
point_10 = Point(flatten([list_item_32.Item, list_item_32.Item1, list_item_32.Item2]))
point_11 = Point(flatten([list_item_33.Item, list_item_33.Item1, list_item_33.Item2]))
point_12 = Point(flatten([list_item_30.Item, list_item_30.Item1, list_item_30.Item2]))
mesh_7 = Mesh([list_item_36.Item, list_item_36.Item1, list_item_36.Item2])
linear_dimension_3 = LinearDimension(Line=line_6, PointA=point_12, PointB=point_9, Text="{0:0.00}", Size=0.3)
linear_dimension_4 = LinearDimension(Line=line_7, PointA=point_10, PointB=point_11, Text="{0:0.00}", Size=0.3)

# ---- group: GETTING THE WIDTHS AND HEIGHTS FOR EACH PANEL
# Add units
flat_mesh_strips_8 = RemoteReceiver(flat_mesh_strips)

# ---- group: GETTING THE WIDTHS AND HEIGHTS FOR EACH PANEL / total length of roll required
# Add units
mass_addition = MassAddition(Input=deconstruct_vector_2.YComponent)  # -> Result, PartialResults
expression = Expression(x=mass_addition.Result, Expression="Format(\"{0:0}m is the total length required\", x, y)")
round_2 = Round(Number=mass_addition.Result)  # -> Nearest, Floor, Ceiling
panel_22 = Panel(expression)

# ---- group: GETTING THE WIDTHS AND HEIGHTS FOR EACH PANEL / check for acceptable width for panel
# false = 0
# true = 1
# so if the mass addition = the list length
# ( list length = ll *1 = ll)
# then all are true
number_slider_5 = Slider(5, range=0..10)
smaller_than = SmallerThan(FirstNumber=deconstruct_vector.XComponent, SecondNumber=number_slider_5)  # -> SmallerThan, OrEqualTo
list_indices = ListIndices(List=deconstruct_vector.XComponent)
addition = Addition(A=list_indices, B="1")
mass_addition_2 = MassAddition(Input=smaller_than.OrEqualTo)  # -> Result, PartialResults
list_length_2 = ListLength(List=deconstruct_vector.XComponent)
dispatch = Dispatch(List=addition, DispatchPattern=smaller_than.OrEqualTo)  # -> ListA, ListB
equality_2 = Equality(FirstNumber=mass_addition_2.Result, SecondNumber=list_length_2)  # -> Equality, Inequality
subtraction_4 = Subtraction(A=list_length_2, B=mass_addition_2.Result)
expression_2 = Expression(x=subtraction_4, y=number_slider_5, Expression="Format(\"{0} panels exceed the WIDTH limit of {1}m\", x, y)")
expression_3 = Expression(x=dispatch.ListB, Expression="Format(\"panel {0}  exceed the limit \", x, y)")
panel_23 = Panel(equality_2.Equality)
panel_24 = Panel(expression_3)
panel_25 = Panel(expression_2)

# ----
optimum_width_for_roll_2 = RemoteSender(optimum_width_for_roll)

# ---- group: GETTING THE WIDTHS AND HEIGHTS FOR EACH PANEL / area
area_3 = Area(Geometry=flat_mesh_strips_8)  # -> Area, Centroid
mass_addition_3 = MassAddition(Input=area_3.Area)  # -> Result, PartialResults
round_3 = Round(Number=mass_addition_3.Result)  # -> Nearest, Floor, Ceiling
area_of_panels = Panel(mass_addition_3.Result)

# ---- group: GETTING THE WIDTHS AND HEIGHTS FOR EACH PANEL / tagging
list_indices_2 = ListIndices(List=flat_mesh_strips_8)
addition_2 = Addition(A=list_indices_2, B="1")
text_tag_3d = TextTag3D(Location=area_3.Centroid, Text=addition_2, Size=0.5, Justification=5)

# ---- group: OUTPUTS // TO BAKE
lines_linking_panels_to_its_neighbours_2 = RemoteReceiver(lines_linking_panels_to_its_neighbours)
height_dimensions = LinearDimension(Line=move_4.Geometry, PointA=point_7, PointB=point_8, Text="{0:0.00}", Size=Slider(2, range=0..2))
width_dimensions = LinearDimension(Line=move_3.Geometry, PointA=point_5, PointB=point_6, Text="{0:0.00}", Size=Slider(2, range=0..2))
labels_for_panels = TextTag3D(Location=area_3.Centroid, Text=addition_2, Size=Slider(5, range=0..5), Justification=5)

# ---- group: GETTING THE WIDTHS AND HEIGHTS FOR EACH PANEL / Area of wasted material
multiplication_5 = Multiplication(A=round_2.Ceiling, B=round.Ceiling)
area_of_roll_required = Panel(multiplication_5)
subtraction_5 = Subtraction(A=multiplication_5, B=round_3.Ceiling)

# ---- group: GETTING THE WIDTHS AND HEIGHTS FOR EACH PANEL
total_area = RemoteSender(area_of_panels)
total_length_of_roll_required = RemoteSender(panel_22)

# ----
wasted_area = RemoteSender(subtraction_5)

# ---- group: GETTING THE WIDTHS AND HEIGHTS FOR EACH PANEL / width and length for all panels
tree_statistics_3 = TreeStatistics(Tree=vector_2pt_4.Vector)  # -> Paths, Length, Count
construct_domain_3 = ConstructDomain(DomainStart="1", DomainEnd=tree_statistics_3.Count)
subtraction_6 = Subtraction(A=tree_statistics_3.Count, B="1")
range_3 = Range(Domain=construct_domain_3, Steps=subtraction_6)
expression_4 = Expression(
    x=panel_17,
    y=panel_18,
    z=range_3,
    Expression="Format(\"the max width of panel {0:0} is {1:0.00}, the maximum length is {2:0.00}\",z, x, y)")
panel_26 = Panel(expression_4)

# ----
width_check = RemoteSender(panel_25)

# ---- group: INFORMATION ABOUT THE PANELS
total_length_of_roll_required_2 = RemoteReceiver(total_length_of_roll_required)
total_area_2 = RemoteReceiver(total_area)
optimum_width_for_roll_3 = RemoteReceiver(optimum_width_for_roll_2)
wasted_area_2 = RemoteReceiver(wasted_area)
width_check_2 = RemoteReceiver(width_check)
length_of_fabric_roll_required = Panel(total_length_of_roll_required_2)
panel_27 = Panel(width_check_2)
total_area_of_roll_wasted_m2 = Panel(wasted_area_2)
# PATTERNING:
# CODE FOR THE
# EXTRA OUTPUTS
total_area_of_panels_m2 = Panel(total_area_2)
optimum_width_for_roll_4 = Panel(optimum_width_for_roll_3)
