# Grasshopper definition MAKING MESH_EXPORTING GSA FILE.gh (Grasshopper 1.0.8)
# plug-ins: Pufferfish, GSA, Kangaroo2 Components, Telepathy

width = Slider(100, range=0..200)
length = Slider(100, range=0..200)
ellipse = Ellipse(Plane=PlaneXY(0, 0, 0), Radius1=length, Radius2=width)  # -> Ellipse, Focus1, Focus2

number_of_arches = ValueList({"One": 1, "Two": 2² - 1, "Four": 5, "Six": 7, "Eight": 9, "Ten": 11, "Twelve": 13}, selected="Eight")

# ---- group: to change the seam of ellipse
evaluate_length = EvaluateLength(Curve=ellipse.Ellipse, Length=Slider(0.25, range=0..0.5), Normalized=True)  # -> Point, Tangent, Parameter
seam = Seam(Curve=ellipse.Ellipse, Seam=evaluate_length.Parameter)
multiplication = Multiplication(A=number_of_arches, B="2")
divide_curve = DivideCurve(Curve=seam, Count=multiplication, Kinks=False)  # -> Points, Tangents, Parameters

# ----
deconstruct = Deconstruct(Point=divide_curve.Points)  # -> XComponent, YComponent, ZComponent
sort_list = SortList(Keys=deconstruct.YComponent, ValuesValuesA=divide_curve.Points)  # -> Keys, ValuesValuesA
list_length = ListLength(List=sort_list.ValuesValuesA)
division = Division(A=list_length, B="2")
partition_list = PartitionList(List=sort_list.ValuesValuesA, Size=division)
deconstruct_2 = Deconstruct(Point=partition_list)  # -> XComponent, YComponent, ZComponent
sort_list_2 = SortList(Keys=deconstruct_2.XComponent, ValuesValuesA=partition_list)  # -> Keys, simplify(ValuesValuesA)
explode_tree = ExplodeTree(Data=sort_list_2.ValuesValuesA)  # -> Branch0, Branch1
entwine = Entwine(Branch00=explode_tree.Branch1, Branch01=explode_tree.Branch0, FlattenInputs=True)
flip_matrix = FlipMatrix(Data=entwine)  # -> simplify(Data)

# ----
# LIST OF PLUGINS REQUIRED:
# - KANGAROO 2
# - GH GSA PLUGIN
# - TELEPATHY
list_item = ListItem(List=flip_matrix, Index=0, Wrap=True)  # -> Item, Item1; disabled
line = Line(StartPoint=list_item.Item, EndPoint=list_item.Item1)  # -> flatten(Line); disabled
list_length_2 = ListLength(List=line)  # disabled
panel = Panel("2")  # disabled
division_2 = Division(A=list_length_2, B=panel)  # disabled
partition_list_2 = PartitionList(List=line, Size=division_2)  # -> simplify(Chunks); disabled
panel_2 = Panel("0")  # disabled
tree_branch = TreeBranch(Tree=partition_list_2, Path=panel_2, MaintainPaths=True)  # disabled
length_2 = Length(Curve=tree_branch)  # disabled
list_indices = ListIndices(List=tree_branch)  # disabled
panel_3 = Panel("75")  # disabled
smaller_than = SmallerThan(FirstNumber=length_2, SecondNumber=panel_3)  # -> SmallerThan, OrEqualTo; disabled
dispatch = Dispatch(List=list_indices, DispatchPattern=smaller_than.SmallerThan)  # -> ListA, ListB; disabled
tree_branch_2 = TreeBranch(Tree=flip_matrix, Path=dispatch.ListA, MaintainPaths=True)  # disabled

# ---- group: for changing the width of the opening
tree_branch_3 = TreeBranch(Tree=flip_matrix, Path="0", MaintainPaths=True)
list_item_2 = ListItem(List=tree_branch_3, Index=0, Wrap=True)  # -> Item, Item1
line_2 = Line(StartPoint=list_item_2.Item, EndPoint=list_item_2.Item1)
curve_middle = CurveMiddle(Curve=line_2)
move_away_from = MoveAwayFrom(Geometry=[list_item_2.Item, list_item_2.Item1], Emitter=curve_middle, Distance=Slider(18, range=0..30))  # -> flatten(Geometry), Transform

# ---- group: arch endpoints
split_tree = SplitTree(Data=flip_matrix, Masks=flatten("{0}"))  # -> Positive, Negative
merge = Merge(Data1=move_away_from.Geometry, Data2=split_tree.Negative)

# ---- group: for changing the width of the opening
panel_4 = Panel("0")  # disabled
tree_branch_4 = TreeBranch(Tree=flip_matrix, Path=panel_4, MaintainPaths=True)  # disabled
list_item_3 = ListItem(List=tree_branch_2, Index=0, Wrap=True)  # -> Item, Item1; disabled
line_3 = Line(StartPoint=list_item_3.Item, EndPoint=list_item_3.Item1)  # disabled
line_4 = Line(StartPoint=list_item_3.Item, EndPoint=list_item_3.Item1)  # disabled
number_slider = Slider(15, range=0..30)  # disabled
length_3 = Length(Curve=line_3)  # disabled
panel_5 = Panel("80")  # disabled
panel_6 = Panel("2")  # disabled
curve_middle_2 = CurveMiddle(Curve=line_4)  # disabled
subtraction = Subtraction(A=panel_5, B=length_3)  # disabled
division_3 = Division(A=subtraction, B=panel_6)  # -> flatten(Result); disabled
list_item_4 = ListItem(List=division_3, Index=0, Wrap=True)  # disabled
list_length_3 = ListLength(List=division_3)  # disabled
sequence = Sequence(Notation="[N-1]/3", Length=list_length_3, Initial=list_item_4)  # disabled
move_away_from_2 = MoveAwayFrom(Geometry=[list_item_3.Item, list_item_3.Item1], Emitter=curve_middle_2, Distance=graft(sequence))  # -> flatten(Geometry), Transform; disabled

# ---- group: making the base curve
flip_matrix_2 = FlipMatrix(Data=merge)
explode_tree_2 = ExplodeTree(Data=flip_matrix_2)  # -> Branch0, reverse(Branch1)
interpolate = Interpolate(Vertices=flatten([explode_tree_2.Branch0, explode_tree_2.Branch1]), Degree=3, Periodic=False, KnotStyle=1)  # -> Curve, Length, Domain
flip_curve = FlipCurve(Curve=interpolate.Curve)  # -> Curve, Flag
curve_closest_point = CurveClosestPoint(Point=merge, Curve=flip_curve.Curve)  # -> Point, flatten(Parameter), Distance
shatter = Shatter(Curve=flip_curve.Curve, Parameters=curve_closest_point.Parameter)

# ---- group: making the arches
split_tree_2 = SplitTree(Data=reverse(merge), Masks=flatten("{0}"))  # -> reverse(Positive), reverse(Negative)
list_item_5 = ListItem(List=[split_tree_2.Negative, split_tree_2.Positive], Index=0, Wrap=True)  # -> Item, Item1
line_5 = Line(StartPoint=list_item_5.Item, EndPoint=list_item_5.Item1)
curve_middle_3 = CurveMiddle(Curve=line_5)
length_4 = Length(Curve=line_5)
division_4 = Division(A=length_4, B="2")
multiplication_2 = Multiplication(A=division_4, B=Slider(0.8, range=0..1))
unit_z = UnitZ(Factor=multiplication_2)
move = Move(Geometry=curve_middle_3, Motion=unit_z)  # -> Geometry, Transform
arc_3pt = Arc3Pt(PointA=list_item_5.Item, PointB=move.Geometry, PointC=list_item_5.Item1)  # -> simplify(flatten(Arc)), Plane, Radius

# ---- group: alternate way to make curves
number_slider_2 = Slider(0, range=0..3.14)  # disabled
unit_y = UnitY(Factor=1)  # disabled
unit_z_2 = UnitZ(Factor=1)  # disabled
negative = Negative(Value=number_slider_2)  # disabled
rotate = Rotate(Vector=unit_z_2, Axis=unit_y, Angle=negative)  # disabled
arc_sed = ArcSED(Start=list_item_5.Item, End=list_item_5.Item1, Direction=rotate)  # -> Arc, Plane, Radius; disabled

# ---- group: width of entrance
list_item_6 = ListItem(List=move_away_from.Geometry, Index=0, Wrap=True)  # -> Item, Item1
line_6 = Line(StartPoint=list_item_6.Item, EndPoint=list_item_6.Item1)
length_5 = Length(Curve=line_6)
width_of_entrance_m = Panel(length_5)

# ---- group: to get the middle segment in the curved line
list_length_4 = ListLength(List=shatter)
division_5 = Division(A=list_length_4, B="2")
round = Round(Number=division_5)  # -> Nearest, Floor, Ceiling

# ----
curve_middle_4 = CurveMiddle(Curve=arc_3pt.Arc)
line_7 = Line(StartPoint=curve_middle_4, EndPoint=flatten(curve_middle_3))

# ---- group: final arches
clean_tree = CleanTree(RemoveNulls=True, RemoveInvalid=True, RemoveEmpty=False, Tree=arc_3pt.Arc)
list_item_7 = ListItem(List=shatter, Index=round.Floor, Wrap=True)
flip_curve_2 = FlipCurve(Curve=list_item_7)  # -> Curve, Flag
shift_list = ShiftList(List=clean_tree, Shift=-1, Wrap=False)  # -> reverse(List)
merge_2 = Merge(Data1=flip_curve_2.Curve, Data2=shift_list)  # -> flatten(Result)

# ---- group: Entrance arch height
list_item_8 = ListItem(List=flatten(line_7), Index=0, Wrap=True)
height_of_entrance_m = Panel(list_item_8)

# ---- group: Making lines for Loft
divide_curve_2 = DivideCurve(Curve=merge_2, Count="21", Kinks=False)  # -> simplify(Points), Tangents, Parameters
deconstruct_3 = Deconstruct(Point=divide_curve_2.Points)  # -> XComponent, YComponent, ZComponent
sort_list_3 = SortList(Keys=deconstruct_3.YComponent, ValuesValuesA=divide_curve_2.Points)  # -> Keys, ValuesValuesA
relative_item = RelativeItem(Tree=sort_list_3.ValuesValuesA, Offset="{1}(0)", WrapPaths=False, WrapItems=False)  # -> ItemA, ItemB
line_8 = Line(StartPoint=relative_item.ItemA, EndPoint=relative_item.ItemB)  # -> simplify(Line)
cull_index = CullIndex(List=shatter, Indices=round.Floor, Wrap=True)
flip_matrix_3 = FlipMatrix(Data=line_8)
split_list = SplitList(List=cull_index, Index=round.Floor)  # -> ListA, reverse(ListB)
tree_statistics = TreeStatistics(Tree=flip_matrix_3)  # -> Paths, Length, Count
flip_curve_3 = FlipCurve(Curve=split_list.ListB)  # -> Curve, Flag
entwine_2 = Entwine(Branch00=split_list.ListA, Branch01=flip_curve_3.Curve, FlattenInputs=True)  # -> reverse(simplify(Result))
list_item_9 = ListItem(List=reverse(tree_statistics.Paths), Index=0, Wrap=True)
list_item_10 = ListItem(List=tree_statistics.Paths, Index=0, Wrap=True)
merge_3 = Merge(Data1=list_item_10, Data2=list_item_9)
tree_statistics_2 = TreeStatistics(Tree=entwine_2)  # -> Paths, Length, Count
replace_paths = ReplacePaths(Data=entwine_2, Search=tree_statistics_2.Paths, Replace=merge_3)
split_tree_3 = SplitTree(Data=flip_matrix_3, Masks=flatten(merge_3))  # -> Positive, Negative
flip_curve_4 = FlipCurve(Curve=replace_paths)  # -> Curve, Flag
merge_4 = Merge(Data1=flip_curve_4.Curve, Data2=split_tree_3.Negative)

# ---- group: for number of arches study
circle_10_arches_full_height = Mesh(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)
circle_8_arches_full_height = Mesh(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)
circle_6_arches_full_height = Mesh(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)

# ---- group: for height study
circle_8_arches_full_height_2 = Mesh(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)
circle_8_arches_0_8_height = Mesh(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)
circle_8_arches_0_6_height = Mesh(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)

# ---- group: to rotate //for even number of arches
list_item_11 = ListItem(List=split_tree.Positive, Index=0, Wrap=True)  # -> Item, Item1
vector_2pt = Vector2Pt(PointA=list_item_11.Item1, PointB=list_item_11.Item, Unitize=False)  # -> Vector, Length
unit_y_2 = UnitY(Factor=1)
angle = Angle(VectorA=vector_2pt.Vector, VectorB=unit_y_2)  # -> Angle, Reflex

# ----
pre_formfinding_mesh = RemoteSender(circle_8_arches_full_height)

# ---- group: Making the surfaces
flip_matrix_4 = FlipMatrix(Data=merge_4)
loft = Loft(Curves=flip_matrix_4, Options={Adjust=False, Closed=False, LoftEnds=0, LoftSimp=0, LoftType=0, Rebuild=10, Refit=0.01})
rotate_2 = Rotate(Geometry=loft, Angle=angle.Angle, Plane=PlaneXY(0, 0, 0))  # -> Geometry, Transform

# ---- group: Making mesh out of loft
number_slider_3 = Slider(21, range=0..50)
mesh_surface = MeshSurface(Surface=rotate_2.Geometry, UCount=number_slider_3, VCount=number_slider_3, Overhang=True, Equalize=True)  # -> flatten(Mesh)
data_dam = DataDam(DataDataA=number_slider_3, BufferDelay=10000000, BufferMode=0)
list_length_5 = ListLength(List=mesh_surface)
u_v_count = RemoteSender(data_dam)
combine_clean = CombineClean(Meshes=mesh_surface)
no_of_meshes = RemoteSender(list_length_5)
data_dam_2 = DataDam(DataDataA=combine_clean, BufferDelay=10000000, BufferMode=0)

# ---- group: Creating Quads
create_material = CreateMaterial(Material_type="Fabric", Grade="Taconic Solus 1300")
pre_formfinding_mesh_2 = RemoteReceiver(pre_formfinding_mesh)
create_2d_property = Create2DProperty(Material=create_material, Type="Fabric")
create_2d_element = Create2DElement(Geometry=pre_formfinding_mesh_2, Property2D=create_2d_property, Preview3dSection=False)

# ---- group: Creating Nodes
# Making the Mesh
pre_formfinding_mesh_3 = RemoteReceiver(pre_formfinding_mesh)
deconstruct_mesh = DeconstructMesh(Mesh=pre_formfinding_mesh_3)  # -> Vertices, Faces, Colours, Normals
cull_duplicates = CullDuplicates(Points=deconstruct_mesh.Vertices, Tolerance=0.1, CullMode=3)  # -> Points, Indices, Valence
create_support = CreateSupport(Point=cull_duplicates.Points, Plane=PlaneXY(0, 0, 0), x=False, xx=False, y=False, yy=False, z=False, zz=False)
create_model = CreateModel(
    Properties=create_material,
    GSAGeometryIn_m=flatten([create_2d_element, create_support]),
    ReMesh=True,
    Tolerance=0.01,
    Unit="m")

# ---- group: why quads only generates bad vertice list
create_model_2 = CreateModel(GSAGeometryIn_mm=create_2d_element, ReMesh=True, Tolerance=0.001, Unit="mm")
panel_7 = Panel("C:\My_Files\Uni_Stuff\2024-2025 YR5\Semester 1\Grasshopper files\6th jan gsa\6th jan quads only.gwb")
save_gsa_model = SaveGSAModel(GSAModel=create_model_2, Save=Button(), FileAndPath=panel_7)
get_model_geometry = GetModelGeometry(GSAModel=save_gsa_model, ElementFilterList=Slider(100, range=1..100), Mode=1, Unit="mm")  # -> NodesIn_mm, _1DElementsIn_mm, _2DElementsIn_mm, _3DElementsIn_mm, _1DMembersIn_mm, _2DMembersIn_mm, _3DMembersIn_mm, Assemblies
list_item_12 = ListItem(List=get_model_geometry._2DElementsIn_mm, Index=0, Wrap=True)

# ----
# EXPORTING
# STEP 1
# remove the save model?
sort_points = SortPoints(Points=cull_duplicates.Points)  # -> Points, Indices

# ---- group: For custom fabric
weave_strength_kn_m = Panel("400")  # disabled
shear_modulus_kn_m = Panel("38")  # disabled
name_of_fabric = Panel("fabric 1")  # disabled
analysis_material_number = Panel("1")  # disabled
warp_strength_kn_m = Panel("700")  # disabled
poisson_s_ratio = Panel("0.3")  # disabled
density_t_m2 = Panel("0.001")  # disabled

expression = Expression(
    x=name_of_fabric,
    y=warp_strength_kn_m,
    z=weave_strength_kn_m,
    u=poisson_s_ratio,
    v=shear_modulus_kn_m,
    w=density_t_m2,
    a=analysis_material_number,
    Expression="Format(\"MAT_FABRIC.11,1,{0},{1},{2},{3},{4},{5},0,MAT_ANAL.1,Fabric,{6},MAT_FABRIC,5,{1},{2},{3},{4},{5},1,0,0,0,0,0,0,0,MAT_CURVE_PARAM.3,,UNDEF,0,0,0,0,0,0,1,1,MAT_CURVE_PARAM.3,,UNDEF,0,0,0,0,0,0,1,1,0,Fabric,NO\", x, y,z,u,v,w,a)")  # disabled

# ---- group: making the spacers
pre_formfinding_mesh_4 = RemoteReceiver(pre_formfinding_mesh)
deconstruct_mesh_2 = DeconstructMesh(Mesh=pre_formfinding_mesh_4)  # -> Vertices, Faces, Colours, Normals
deconstruct_face = DeconstructFace(Face=deconstruct_mesh_2.Faces)  # -> CornerA, CornerB, CornerC, CornerD
# EXPORTING
# STEP 2
# Adding the Spacers
list_item_13 = ListItem(List=deconstruct_mesh_2.Vertices, Index=deconstruct_face.CornerC, Wrap=True)
list_item_14 = ListItem(List=deconstruct_mesh_2.Vertices, Index=deconstruct_face.CornerB, Wrap=True)
list_item_15 = ListItem(List=deconstruct_mesh_2.Vertices, Index=deconstruct_face.CornerD, Wrap=True)
list_item_16 = ListItem(List=deconstruct_mesh_2.Vertices, Index=deconstruct_face.CornerA, Wrap=True)
line_9 = Line(StartPoint=list_item_13, EndPoint=list_item_14)
line_10 = Line(StartPoint=list_item_15, EndPoint=list_item_16)

no_of_meshes_2 = RemoteReceiver(no_of_meshes)
list_length_6 = ListLength(List=line_9)
division_6 = Division(A=list_length_6, B=no_of_meshes_2)
partition_list_3 = PartitionList(List=line_9, Size=division_6)  # -> simplify(Chunks)
u_v_count_2 = RemoteReceiver(u_v_count)
partition_list_4 = PartitionList(List=partition_list_3, Size=u_v_count_2)
path_mapper = PathMapper(partition_list_4, source="{A;B}", target="{B}")
end_points = EndPoints(Curve=path_mapper)  # -> Start, End
list_item_17 = ListItem(List=end_points.End, Index=0, Wrap=True)
merge_5 = Merge(Data1=list_item_17, Data2=end_points.Start)

list_length_7 = ListLength(List=line_10)
no_of_meshes_3 = RemoteReceiver(no_of_meshes)
division_7 = Division(A=list_length_7, B=no_of_meshes_3)
partition_list_5 = PartitionList(List=line_10, Size=division_7)  # -> simplify(Chunks)

u_v_count_3 = RemoteReceiver(u_v_count)
partition_list_6 = PartitionList(List=partition_list_5, Size=u_v_count_3)
path_mapper_2 = PathMapper(partition_list_6, source="{A;B}", target="{B}")
param_viewer = ParamViewer(merge_5)
end_points_2 = EndPoints(Curve=path_mapper_2)  # -> Start, End
list_item_18 = ListItem(List=reverse(param_viewer), Index=0, Wrap=True)
list_item_19 = ListItem(List=end_points_2.End, Index=0, Wrap=True)
tree_branch_5 = TreeBranch(Tree=merge_5, Path=list_item_18, MaintainPaths=True)
merge_6 = Merge(Data1=list_item_19, Data2=end_points_2.Start)
tree_statistics_3 = TreeStatistics(Tree=merge_6)  # -> Paths, Length, Count
replace_paths_2 = ReplacePaths(Data=tree_branch_5, Search=list_item_18, Replace=tree_statistics_3.Count)
merge_7 = Merge(Data1=merge_6, Data2=replace_paths_2)

# ---- group: making the spacers / segments in u spacer
list_length_8 = ListLength(List=partition_list_5)
u_v_count_4 = RemoteReceiver(u_v_count)
tree_statistics_4 = TreeStatistics(Tree=partition_list_5)  # -> Paths, Length, Count
division_8 = Division(A=list_length_8, B=u_v_count_4)  # -> flatten(Result)
list_item_20 = ListItem(List=division_8, Index=0, Wrap=True)
multiplication_3 = Multiplication(A=list_item_20, B=tree_statistics_4.Count)
number_of_segments_in_one_u_spacer = RemoteSender(multiplication_3)

# ---- group: making the spacers
polyline = PolyLine(Vertices=merge_7, Closed=False)  # -> flatten(Polyline)
list_indices_2 = ListIndices(List=polyline)
u_curve = RemoteSender(polyline)
list_item_21 = ListItem(List=reverse(list_indices_2), Index=0, Wrap=True)
u_v_count_5 = RemoteReceiver(u_v_count)
division_9 = Division(A=list_item_21, B=u_v_count_5)
addition = Addition(A="1", B=division_9)
series = Series(Start=0, Step=1, Count=addition)
u_v_count_6 = RemoteReceiver(u_v_count)
multiplication_4 = Multiplication(A=series, B=u_v_count_6)
cull_index_2 = CullIndex(List=polyline, Indices=multiplication_4, Wrap=True)

flip_matrix_5 = FlipMatrix(Data=merge_7)
polyline_2 = PolyLine(Vertices=flip_matrix_5, Closed=False)  # -> flatten(Polyline)

tree_branch_6 = TreeBranch(Tree=flip_matrix_5, Path=Slider(125, range=0..125), MaintainPaths=True)
new_points_arranged = RemoteSender(flip_matrix_5)
v_curves = RemoteSender(polyline_2)

# ---- group: making the spacers / number of segments in v curve
tree_statistics_5 = TreeStatistics(Tree=flip_matrix_5)  # -> Paths, Length, Count
list_item_22 = ListItem(List=tree_statistics_5.Length, Index=0, Wrap=True)
subtraction_2 = Subtraction(A=list_item_22, B="1")
number_of_segments_in_one_v_spacer = RemoteSender(subtraction_2)

# ---- group: making the spacers
list_indices_3 = ListIndices(List=polyline_2)
list_item_23 = ListItem(List=reverse(list_indices_3), Index=0, Wrap=True)
u_v_count_7 = RemoteReceiver(u_v_count)
division_10 = Division(A=list_item_23, B=u_v_count_7)
addition_2 = Addition(A="1", B=division_10)
series_2 = Series(Start=0, Step=1, Count=addition_2)
u_v_count_8 = RemoteReceiver(u_v_count)
multiplication_5 = Multiplication(A=series_2, B=u_v_count_8)
v_curves_2 = RemoteReceiver(v_curves)
v_curves_3 = RemoteReceiver(v_curves)
cull_index_3 = CullIndex(List=v_curves_2, Indices=multiplication_5, Wrap=True)
list_item_24 = ListItem(List=v_curves_3, Index=multiplication_5, Wrap=True)
list_length_9 = ListLength(List=cull_index_3)
v_curves_for_steel_structure = RemoteSender(list_item_24)
number_of_spacer_chains_in_v_direction = RemoteSender(list_length_9)

# ----
pre_formfinding_mesh_5 = RemoteReceiver(pre_formfinding_mesh)

# ---- group: warpweft is not reliable
warpweft = WarpWeft(Mesh=pre_formfinding_mesh_5)  # -> Warp, Weft, NakedA, NakedB
curve = Curve(warpweft.Warp)
curve_2 = Curve(warpweft.Weft)

# ---- group: making the spacers
u_curve_2 = RemoteReceiver(u_curve)
cull_index_4 = CullIndex(List=u_curve_2, Indices=multiplication_4, Wrap=True)
list_length_10 = ListLength(List=cull_index_4)
number_of_spacer_chains_in_u_direction = RemoteSender(list_length_10)

# ---- group: check
deconstruct_mesh_3 = DeconstructMesh(Mesh=pre_formfinding_mesh_5)  # -> Vertices, Faces, Colours, Normals
cull_duplicates_2 = CullDuplicates(Points=deconstruct_mesh_3.Vertices, Tolerance=0.1, CullMode=3)  # -> Points, Indices, Valence
list_length_11 = ListLength(List=deconstruct_mesh_3.Faces)
list_length_12 = ListLength(List=deconstruct_mesh_3.Vertices)
number_of_quads = Panel(list_length_11)
number_of_vertices_unculled = Panel(list_length_12)
list_length_13 = ListLength(List=cull_duplicates_2.Points)
number_of_vertices_culled = Panel(list_length_13)

# ---- group: making the spacers
u_curve_3 = RemoteReceiver(u_curve)
list_item_25 = ListItem(List=u_curve_3, Index=multiplication_4, Wrap=True)
u_curves_for_steel_structure = RemoteSender(list_item_25)

# ----
discontinuity = Discontinuity(Curve=cull_index_2, Level=1)  # -> Points, Parameters
shatter_2 = Shatter(Curve=cull_index_2, Parameters=discontinuity.Parameters)
flatten_tree = FlattenTree(Tree=shatter_2, Path="{0}")
list_item_26 = ListItem(List=flatten_tree, Index=[Slider(5, range=0..5), Slider(4, range=0..5)], Wrap=True)

pre_formfinding_mesh_s_culled_vertices = RemoteSender(cull_duplicates_2.Points)

pre_formfinding_mesh_s_culled_vertices_2 = RemoteReceiver(pre_formfinding_mesh_s_culled_vertices)
create_1d_member = Create1DMember(
    Curve=[cull_index_2, cull_index_3],
    Preview3dSection=False,
    x1=False,
    x2=False,
    xx1=False,
    xx2=False,
    y1=False,
    y2=False,
    yy1=False,
    yy2=False,
    z1=False,
    z2=False,
    zz1=False,
    zz2=False)  # -> flatten(Member1D)
create_elements_from_members = CreateElementsFromMembers(Nodes_mm=pre_formfinding_mesh_s_culled_vertices_2, _1DMembers_mm=create_1d_member, Tolerance=0.01, Unit="m")  # -> Nodes, _1DElements, _2DElements, _3DElements, GSAModel

# ----
# manipulates the order of
# the elements so that elements
#  in the same line are in grouped
# together rather than scattered
# about, like above
number_slider_4 = Slider(139, range=0..139)
list_item_27 = ListItem(List=create_1d_member, Index=number_slider_4, Wrap=True)
number_of_spacer_chains_in_u_direction_2 = RemoteReceiver(number_of_spacer_chains_in_u_direction)

# ---- group: list for adjusting the spacer IDs so quads don't get overwritten
pre_formfinding_mesh_6 = RemoteReceiver(pre_formfinding_mesh)
list_indices_4 = ListIndices(List=create_elements_from_members._1DElements)
deconstruct_mesh_4 = DeconstructMesh(Mesh=pre_formfinding_mesh_6)  # -> Vertices, Faces, Colours, Normals
addition_3 = Addition(A=list_indices_4, B="1")
list_length_14 = ListLength(List=deconstruct_mesh_4.Faces)
addition_4 = Addition(A=addition_3, B=list_length_14)

# ---- group: Spacer property assigner
edit_1d_element = Edit1DElement(Element1D=create_elements_from_members._1DElements, Number=addition_4, Type="19", Preview3dSection=False)  # -> Element1D, Number, Line, Property, Group, Type, Offset, StartRelease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
number_of_spacer_chains_in_u_direction_3 = RemoteReceiver(number_of_spacer_chains_in_u_direction)
number_of_spacer_chains_in_v_direction_2 = RemoteReceiver(number_of_spacer_chains_in_v_direction)
list_item_28 = ListItem(List=edit_1d_element.Topology, Index=0, Wrap=True)  # -> flatten(Item)
list_item_29 = ListItem(List=edit_1d_element.Topology, Index=Slider(1, range=0..1), Wrap=True)  # -> flatten(Item)
addition_5 = Addition(A=number_of_spacer_chains_in_u_direction_2, B="1")
sequence_2 = Sequence(Notation="[N-1] + 1", Length=number_of_spacer_chains_in_v_direction_2, Initial=addition_5)  # -> simplify(graft(Sequence))
sequence_3 = Sequence(Notation="[N-1] + 1", Length=number_of_spacer_chains_in_u_direction_3, Initial="1")  # -> simplify(graft(Sequence))
number_of_segments_in_one_v_spacer_2 = RemoteReceiver(number_of_segments_in_one_v_spacer)
number_of_segments_in_one_u_spacer_2 = RemoteReceiver(number_of_segments_in_one_u_spacer)
duplicate_data = DuplicateData(Data=sequence_2, Number=number_of_segments_in_one_v_spacer_2, Order=True)  # -> flatten(Data)
duplicate_data_2 = DuplicateData(Data=sequence_3, Number=number_of_segments_in_one_u_spacer_2, Order=True)  # -> flatten(Data)
merge_8 = Merge(Data1=duplicate_data_2, Data2=duplicate_data)
spacer_properties_assigner = Expression(
    Spacer_ID=edit_1d_element.Number,
    Assigned_spacer_property_number=merge_8,
    start_node=list_item_28,
    end_node=list_item_29,
    Expression="Format(\"SET,EL.4,{0},,NO_RGB,SPACER,{1},1,{2},{3},0,0,NO_RLS,0,0,0,0,,3\",Spacer_ID, Assigned_spacer_property_number, start_node,end_node)")
panel_8 = Panel(spacer_properties_assigner)

# ----
pre_formfinding_mesh_s_culled_vertices_3 = RemoteReceiver(pre_formfinding_mesh_s_culled_vertices)
pre_formfinding_mesh_s_culled_vertices_4 = RemoteReceiver(pre_formfinding_mesh_s_culled_vertices)

new_points_arranged_2 = RemoteReceiver(new_points_arranged)
new_points_arranged_3 = RemoteReceiver(new_points_arranged)
tree_statistics_6 = TreeStatistics(Tree=new_points_arranged_2)  # -> Paths, Length, Count
u_v_count_9 = RemoteReceiver(u_v_count)
subtraction_3 = Subtraction(A=tree_statistics_6.Count, B="1")
deconstruct_4 = Deconstruct(Point=new_points_arranged_3)  # -> XComponent, YComponent, ZComponent
division_11 = Division(A=subtraction_3, B=u_v_count_9)
addition_6 = Addition(A="1", B=division_11)
sort_list_4 = SortList(Keys=deconstruct_4.ZComponent, ValuesValuesA=new_points_arranged_3)  # -> Keys, ValuesValuesA
sequence_4 = Sequence(Notation="[N-1] + 1", Length=addition_6, Initial=0)
u_v_count_10 = RemoteReceiver(u_v_count)
new_points_arranged_4 = RemoteReceiver(new_points_arranged)
multiplication_6 = Multiplication(A=u_v_count_10, B=sequence_4)
tree_branch_7 = TreeBranch(Tree=new_points_arranged_4, Path=multiplication_6, MaintainPaths=True)
list_item_30 = ListItem(List=sort_list_4.ValuesValuesA, Index=[Slider(0, range=0..1), "1"], Wrap=True)
point = Point(flatten(tree_branch_7))
merge_9 = Merge(Data1=list_item_30, Data2=point)  # -> flatten(Result)
pre_formfinding_mesh_s_culled_vertices_5 = RemoteReceiver(pre_formfinding_mesh_s_culled_vertices)
new_points_arranged_5 = RemoteReceiver(new_points_arranged)
cull_duplicates_3 = CullDuplicates(Points=merge_9, Tolerance=0.1, CullMode=3)  # -> Points, Indices, Valence
member_index = MemberIndex(Set=pre_formfinding_mesh_s_culled_vertices_5, Member=flatten(new_points_arranged_5))  # -> flatten(Index), Count
member_index_2 = MemberIndex(Set=pre_formfinding_mesh_s_culled_vertices_3, Member=flatten(cull_duplicates_3.Points))  # -> flatten(Index), Count
pre_formfinding_mesh_s_culled_vertices_6 = RemoteReceiver(pre_formfinding_mesh_s_culled_vertices)
cull_index_5 = CullIndex(List=pre_formfinding_mesh_s_culled_vertices_4, Indices=member_index.Index, Wrap=True)
member_index_3 = MemberIndex(Set=pre_formfinding_mesh_s_culled_vertices_4, Member=cull_index_5)  # -> Index, Count
list_item_31 = ListItem(List=pre_formfinding_mesh_s_culled_vertices_3, Index=member_index_2.Index, Wrap=True)
list_item_32 = ListItem(List=pre_formfinding_mesh_s_culled_vertices_6, Index=member_index_3.Index, Wrap=True)  # -> flatten(Item)
merge_10 = Merge(Data1=member_index_2.Index, Data2=member_index_3.Index)
cull_duplicates_4 = CullDuplicates(Points=flatten([list_item_31, list_item_32]), Tolerance=0.1, CullMode=3)  # -> Points, Indices, Valence
sort_list_5 = SortList(Keys=merge_10)  # -> flatten(Keys), ValuesValuesA
anchor_points = RemoteSender(cull_duplicates_4.Points)
anchor_point_indices = RemoteSender(sort_list_5.Keys)

# ---- group: Spacer property command generator
number_of_spacer_chains_in_v_direction_3 = RemoteReceiver(number_of_spacer_chains_in_v_direction)
number_of_spacer_chains_in_u_direction_4 = RemoteReceiver(number_of_spacer_chains_in_u_direction)
addition_7 = Addition(A=number_of_spacer_chains_in_v_direction_3, B=number_of_spacer_chains_in_u_direction_4)
series_3 = Series(Start="1", Step=1, Count=addition_7)
expression_2 = Expression(x=series_3, Expression="Format(\"Spacer prop.{0}\", x)")
expression_3 = Expression(
    entry_number=series_3,
    Spacer_prop_x=expression_2,
    Expression="Format(\"PROP_SPACER.2,{0},{1},NO_RGB,0,GEODESIC,RATIO,1,1\", entry_number, Spacer_prop_x)")
commands_generated_for_making_spacer_pro = Panel(expression_3)  # "Commands Generated for making Spacer Properties"

# ----
panel_9 = Panel("SET,PROP_2D.8,1,2D prop. 1,NO_RGB,FABRIC,GLOBAL,0,FABRIC,1,0,0(mm),CENTROID,0,0,100%,100%,100%,100%")
gwa_command = GWACommand(GSAModel=create_model, GWAString=flatten([expression, panel_9]))  # -> Model, ReturnedResult
gwa_command_2 = GWACommand(GSAModel=gwa_command.Model, GWAString=flatten([expression_3, spacer_properties_assigner]))  # -> Model, ReturnedResult
create_model_3 = CreateModel(ModelSListsAndGridLines=gwa_command_2.Model, ReMesh=True, Tolerance=0.01, Unit="m")

# ---- group: Making steel elements
create_material_2 = CreateMaterial(Material_type="Steel", Design_Code="EN 1993-1-1:2005", Grade="S355")
create_profile = CreateProfile(
    Depth_cm=Slider(10, range=1..10),
    Width_cm=Slider(5, range=1..10),
    catalogueIndex=-1,
    inclSS=False,
    lengthUnit="Centimeter",
    mode="Other",
    Profile_type="Rectangle",
    Measure="cm",
    typeIndex=-1)
u_curves_for_steel_structure_2 = RemoteReceiver(u_curves_for_steel_structure)
v_curves_for_steel_structure_2 = RemoteReceiver(v_curves_for_steel_structure)
create_section = CreateSection(Profile=create_profile, Material=create_material_2, Basic_Offset="Centroid")
create_1d_member_2 = Create1DMember(
    Curve=v_curves_for_steel_structure_2,
    Property=create_section,
    Preview3dSection=False,
    x1=False,
    x2=False,
    xx1=False,
    xx2=False,
    y1=False,
    y2=False,
    yy1=False,
    yy2=False,
    z1=False,
    z2=False,
    zz1=False,
    zz2=False)  # -> simplify(flatten(Member1D))
create_1d_member_3 = Create1DMember(
    Curve=u_curves_for_steel_structure_2,
    Property=create_section,
    Preview3dSection=False,
    x1=False,
    x2=False,
    xx1=False,
    xx2=False,
    y1=False,
    y2=False,
    yy1=False,
    yy2=False,
    z1=False,
    z2=False,
    zz1=False,
    zz2=False)  # -> simplify(flatten(Member1D))
anchor_points_2 = RemoteReceiver(anchor_points)
anchor_points_3 = RemoteReceiver(anchor_points)
create_elements_from_members_2 = CreateElementsFromMembers(Nodes_mm=anchor_points_2, _1DMembers_mm=create_1d_member_2, Tolerance=1e-06, Unit="m")  # -> Nodes, _1DElements, _2DElements, _3DElements, GSAModel
create_elements_from_members_3 = CreateElementsFromMembers(Nodes_mm=anchor_points_3, _1DMembers_mm=create_1d_member_3, Tolerance=1e-06, Unit="m")  # -> Nodes, _1DElements, _2DElements, _3DElements, GSAModel
merge_11 = Merge(Data1=create_elements_from_members_3._1DElements, Data2=create_elements_from_members_2._1DElements)

# ---- group: Pinned connections
# EXPORTING
# STEP 3
# Making the support structure
#            & adding anchors
anchor_point_indices_2 = RemoteReceiver(anchor_point_indices)
addition_8 = Addition(A=anchor_point_indices_2, B="1")
text_join = TextJoin(Text=addition_8, Join=",")
get_model_geometry_2 = GetModelGeometry(GSAModel=create_model_3, NodeFilterList=flatten(text_join), Mode=1, Unit="m")  # -> flatten(NodesIn_m), _1DElementsIn_m, _2DElementsIn_m, _3DElementsIn_m, _1DMembersIn_m, _2DMembersIn_m, _3DMembersIn_m, Assemblies
create_bool6 = CreateBool6(x=True, xx=False, y=True, yy=False, z=True, zz=False)
edit_node = EditNode(Node=get_model_geometry_2.NodesIn_m, NodeRestraints=create_bool6, Mode=1)  # -> Node, NodeNumber, NodePosition, NodeLocalAxis, NodeRestraints, DamperProperty, MassProperty, SpringProperty, NodeName, NodeColour

# ---- group: for correcting the steel's GSA IDs
pre_formfinding_mesh_7 = RemoteReceiver(pre_formfinding_mesh)
number_of_spacer_chains_in_u_direction_5 = RemoteReceiver(number_of_spacer_chains_in_u_direction)
number_of_segments_in_one_u_spacer_3 = RemoteReceiver(number_of_segments_in_one_u_spacer)
number_of_segments_in_one_v_spacer_3 = RemoteReceiver(number_of_segments_in_one_v_spacer)
number_of_spacer_chains_in_v_direction_4 = RemoteReceiver(number_of_spacer_chains_in_v_direction)
deconstruct_mesh_5 = DeconstructMesh(Mesh=pre_formfinding_mesh_7)  # -> Vertices, Faces, Colours, Normals
list_length_15 = ListLength(List=deconstruct_mesh_5.Faces)
multiplication_7 = Multiplication(A=number_of_spacer_chains_in_u_direction_5, B=number_of_segments_in_one_u_spacer_3)
multiplication_8 = Multiplication(A=number_of_spacer_chains_in_v_direction_4, B=number_of_segments_in_one_v_spacer_3)
mass_addition = MassAddition(Input=flatten([multiplication_7, multiplication_8, list_length_15]))  # -> Result, PartialResults
list_length_16 = ListLength(List=merge_11)
series_4 = Series(Start="1", Step=1, Count=list_length_16)
addition_9 = Addition(A=mass_addition.Result, B=series_4)
edit_1d_element_2 = Edit1DElement(Element1D=merge_11, Number=addition_9, Preview3dSection=False)  # -> Element1D, Number, Line, Property, Group, Type, Offset, StartRelease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

# ----
create_model_4 = CreateModel(
    ModelSListsAndGridLines=create_model_3,
    GSAGeometryIn_mm=flatten([edit_1d_element_2.Element1D, edit_node.Node]),
    ReMesh=True,
    Tolerance=1e-06,
    Unit="m")
get_model_geometry_3 = GetModelGeometry(GSAModel=create_model_4, ElementFilterList="XY1 not PG", Mode=1, Unit="m")  # -> NodesIn_mm, _1DElementsIn_mm, _2DElementsIn_mm, _3DElementsIn_mm, _1DMembersIn_mm, _2DMembersIn_mm, _3DMembersIn_mm, Assemblies
edit_1d_element_3 = Edit1DElement(Element1D=get_model_geometry_3._1DElementsIn_mm, Preview3dSection=False)  # -> Element1D, Number, Line, Property, Group, Type, Offset, StartRelease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

# ---- group: soapfilm formfinding
soap_stress_in_y_direction_kn_m = Slider(17, range=0..40)
# STEP 4
soap_stress_in_x_direction_kn_m = Slider(17, range=0..40)
soap_stress_kn = Slider(5, range=0..20)
expression_4 = Expression(x=soap_stress_kn, Expression="Format(\"SOAP_STRESS_1D,1,stress1,global,{0}\", x)")
expression_5 = Expression(
    x=soap_stress_in_x_direction_kn_m,
    y=soap_stress_in_y_direction_kn_m,
    Expression="Format(\"SOAP_STRESS_2D,1,2D soap film 1,{0}, {1}\", x, y)")
gwa_command_3 = GWACommand(GSAModel=create_model_4, GWAString=flatten([expression_5, expression_4]))  # -> Model, ReturnedResult

# ---- group: Creating the loads
# the units are whatever you have established in the settings which is then converted to the GSA oasys setting in the actual program
number_slider_5 = Slider(1, range=0..10)
create_load_case = CreateLoadCase(CaseID=Slider(2, range=0..10), Name="wind", Type="Wind")
create_load_case_2 = CreateLoadCase(CaseID=number_slider_5, Name="snow", Type="Snow")
create_load_case_3 = CreateLoadCase(CaseID=Slider(3, range=0..10), Name="self weight", Type="Dead")
negative_2 = Negative(Value=Slider(0.3, range=0..1))
create_face_load = CreateFaceLoad(
    LoadCase=create_load_case_2,
    Loadable2DObjects="all",
    Name="snow",
    Axis="0",
    Direction="z",
    Projected=Toggle(True),
    Value_kN_m²=negative_2,
    Type="Uniform",
    Unit="kN/m²")
create_face_load_2 = CreateFaceLoad(
    LoadCase=create_load_case,
    Loadable2DObjects="all",
    Name="wind",
    Axis=-1,
    Direction="z",
    Projected=False,
    Value_kN_m²=Slider(0.4, range=0..1),
    Type="Uniform",
    Unit="kN/m²")
create_gravity_load = CreateGravityLoad(LoadCase=create_load_case_3, LoadableObjects="all", Name="self weight", GravityFactor=Vector(0, 0, -1))

# ----
entwine_3 = Entwine(Branch00=create_face_load, Branch01=create_face_load_2, Branch02=create_gravity_load, FlattenInputs=True)  # -> flatten(Result)
create_model_5 = CreateModel(ModelSListsAndGridLines=gwa_command_3.Model, Load=flatten(entwine_3), ReMesh=True, Tolerance=0.001, Unit="mm")

create_analysis_case = CreateAnalysisCase(Name="prestress only", Description="L4")
create_analysis_case_2 = CreateAnalysisCase(Name="snow and s/w", Description="L1+L3+L4")
create_analysis_case_3 = CreateAnalysisCase(Name="dummy")
create_analysis_case_4 = CreateAnalysisCase(Name="wind and s/w", Description="L2+L3+L4")
create_analysis_task = CreateAnalysisTask(
    TaskID="2",
    Name="nonlinear analysis",
    AnalysisCases=flatten([create_analysis_case_4, create_analysis_case_2, create_analysis_case]),
    casesParamIndex=2,
    Solver="Static")
create_analysis_task_2 = CreateAnalysisTask(TaskID="1", Name="Form-finding", AnalysisCases=flatten(create_analysis_case_3), casesParamIndex=2, Solver="Static")
create_model_6 = CreateModel(
    ModelSListsAndGridLines=create_model_5,
    AnalysisTasksCombinations=reverse(flatten([create_analysis_task, create_analysis_task_2])),
    ReMesh=True,
    Tolerance=0.001,
    Unit="mm")

# ---- group: the GWA command line for the tasks
panel_10 = Panel("C:\My_Files\Uni_Stuff\2024-2025 YR5\Semester 1\Grasshopper files\9th gsa\all geometry and soap stress with task cases .gwb")
open_model = OpenModel(FilenameAndPath=panel_10)
panel_11 = Panel("""GET, TASK,2
GET, TASK,1""")
gwa_command_4 = GWACommand(GSAModel=open_model, GWAString=flatten(panel_11))  # -> Model, ReturnedResult
panel_12 = Panel(gwa_command_4.ReturnedResult)

# ----
panel_13 = Panel("C:\My_Files\Uni_Stuff\2024-2025 YR5\Semester 1\Grasshopper files\Final version\GSA\CHANGING MATERIAL\stronger PTFE.gwb")

panel_14 = Panel("SET,TASK.1,1,Form-finding,0,GSRELAX,FORM_FINDING,SOAP_FORM,1,BEAM_GEO_YES,SHELL_GEO_NO,0.1000000015,9.999999747e-05,0.1000000015,CYCLE,100000,REL,0.001000000047,0.001000000047,DISP_CTRL_YES,0,1,9.999999776,LOAD_CTRL_NO,1,none,1,10,100,RESID_NOCONV,DAMP_VISCOUS,0,0,1,1,1,1,AUTO_MASS_YES,AUTO_DAMP_YES,FF_SAVE_ELEM_FORCE_YES,FF_SAVE_SPACER_FORCE_TO_ELEM,SHOW_PROGRESS_SUM,SHOW_GRAPHIC_NO,DRCEFNSBUT")
panel_15 = Panel("SET,TASK.1,2,Load Analysis,0,GSRELAX,STATIC_NL,SINGLE,1,BEAM_GEO_YES,SHELL_GEO_NO,0.1000000015,9.999999747e-05,0.1000000015,CYCLE,100000,REL,0.001000000047,0.001000000047,DISP_CTRL_YES,0,1,9.999999776,LOAD_CTRL_NO,1,none,2 3 4 ,10,100,RESID_NOCONV,DAMP_VISCOUS,0,0,1,1,1,1,AUTO_MASS_YES,AUTO_DAMP_YES,FF_SAVE_ELEM_FORCE_YES,FF_SAVE_SPACER_FORCE_TO_ELEM,SHOW_PROGRESS_SUM,SHOW_GRAPHIC_NO,DRCEFNSBUT")
gwa_command_5 = GWACommand(GSAModel=create_model_6, GWAString=flatten([panel_14, panel_15]))  # -> Model, ReturnedResult
save_gsa_model_2 = SaveGSAModel(GSAModel=gwa_command_5.Model, Save=Button(), FileAndPath=panel_13)

# ---- group: RUNNING ANALYSIS TASK THROUGH GH
analyse_model = AnalyseModel(ModelSAndLists=save_gsa_model_2, Analyse=True, ReMesh=True, Tolerance=1e-06, Unit="m")  # -> Model, Errors, Warnings, Remarks, Logs; disabled
select_result = SelectResult(GSAModel=analyse_model.Model, Type="AnalysisCase", Case_ID="A3")  # disabled
panel_16 = Panel(analyse_model.Logs)  # disabled
contour_2d_results = Contour2DResults(
    Result=select_result,
    Display=3,
    Mode=0,
    envelope="Absolute",
    flayer=0,
    force="kN/m",
    legend=True,
    legendScale=1,
    length="mm",
    model="mm",
    moment="kN",
    noDec=0,
    Result_Type="Displacement",
    Component="Resolved |U|",
    slider=True,
    stress="MPa",
    val=0,
    valMax=1000,
    valMin=0)  # -> ResultMesh, Colours, Values_mm; disabled
element_2d_displacements = Element2DDisplacements(Result=select_result, Max_Min="All", Unit="mm")  # -> TranslationsX_mm, TranslationsY_mm, TranslationsZ_mm, TranslationsXYZ_mm, RotationXX_rad, RotationYY_rad, RotationZZ_rad, RotationXYZ_rad; disabled
preview_deformed_3d_sections = PreviewDeformed3DSections(Result=select_result, noDec=0, val=4, valMax=1000, valMin=0)  # -> Mesh, Outlines; disabled
