# Grasshopper definition example.gh (Grasshopper 1.0.8)
# plug-ins: Pufferfish

# ---- group: example 3 // more complex parametric design
point = Point(Point(0, 0, 0))
rectangle_2pt = Rectangle2Pt(Plane=PlaneXY(0, 0, 0), PointA=point, PointB=Point(10, 5, 0), Radius=Slider(1, range=0..1))  # -> Rectangle, Length
circle = Circle(Plane=PlaneXY(0, 0, 0), Radius=Slider(1, range=0..2))
area = Area(Geometry=[rectangle_2pt.Rectangle, circle])  # -> Area, Centroid
list_item = ListItem(List=area.Centroid, Index=0, Wrap=True)  # -> Item1, Item
vector_2pt = Vector2Pt(PointA=list_item.Item1, PointB=list_item.Item, Unitize=False)  # -> Vector, Length
move = Move(Geometry=circle, Motion=vector_2pt.Vector)  # -> Geometry, Transform
boundary_surfaces = BoundarySurfaces(Edges=[move.Geometry, rectangle_2pt.Rectangle])
unit_z = UnitZ(Factor=1)
extrude = Extrude(Base=boundary_surfaces, Direction=unit_z)

# ---- group: example 2 // Data trees & branches
random = Random(Range=Domain(0, 1), Number=Slider(8, range=0..100), Seed=2)
round_to_decimal_place = RoundToDecimalPlace(NumberX=random, DecimalPlace="2", RoundType=0)  # -> Rounded, Difference
panel = Panel(random)
partition_list = PartitionList(List=round_to_decimal_place.Rounded, Size="4")  # -> simplify(Chunks)
panel_2 = Panel(partition_list)
partition_list_2 = PartitionList(List=partition_list, Size="2")  # -> simplify(Chunks)
flip_matrix = FlipMatrix(Data=partition_list)
panel_3 = Panel(partition_list_2)
panel_4 = Panel(flip_matrix)

# ---- group: example 1 // how GH works
circle_2 = Circle(Plane=PlaneXY(0, 0, 0), Radius=Slider(1, range=0..2))
boundary_surfaces_2 = BoundarySurfaces(Edges=circle_2)
unit_z_2 = UnitZ(Factor=Slider(4, range=1..10))
extrude_2 = Extrude(Base=boundary_surfaces_2, Direction=unit_z_2)
